vi "Keynote Dashboard.gvi"   [Next Generation LabVIEW Features 0.1.0]
panel controls:
  "stop": bool
  "Shift Tone": bool
  "Pitch Frequency": f64 = 1
  "Shift Tone_2": bool
  "Slider_2": f64
panel indicators:
  "Graph": waveform<f64>
  "Responses": i32
  "Intensity Graph": f64[][]
  "error out": error
  "error out_2": error
types:
  T1 = cluster{"time steps": i32, "frequency bins": i32}
uses:
  NI::Analysis::Measurement::STFT Spectrogram.gvi
diagram:
  Obtain Queue(element data type=waveform<f64> {dt=1, Y=[]}) -> (queue out=w1)
  while {
    call "Read Audio Port.gvi"(Number of Samples=1024) -> (data=w2)
    Waveform Multiply(w2, $Slider_2) -> w3
    Enqueue Element(element=w3, queue=w1)
    stop if $stop
  }
  call "DAQmx Create Task.gvi"() -> (error out=w4, task out=w5)
  call "DAQmx Create Channel (AO-Voltage-Basic).gvi"(error in=w4, task in=w5, physical channels="cDAQ4Mod4/ao0", maximum value=4, minimum value=-4) -> (error out=w6, task out=w7)
  call "DAQmx Timing (Sample Clock).gvi"(error in=w6, task in=w7, rate=51200, sample mode="Continuous Samples"(10123), samples per channel=100000) -> (error out=w8, task out=w9)
  Property Node(instance in=w9, "RegenMode_1453"="Do Not Allow Regeneration"(10158), error in=w8) -> (error out=w10, instance out=w11)
  Initialize Array(element=0, size=1024) -> w12
  call "DAQmx Write (Analog 1D DBL 1Chan NSamp).gvi"(error in=w10, task in=w11, data=w12) -> (error out=w13, task out=w14)
  call "DAQmx Start Task.gvi"(error in=w13, task in=w14) -> (error out=w15, task out=w16)
  while {
    Dequeue Element(queue=w1) -> (element=w17, queue out=w18)
    case ($"Shift Tone") {
      frame False, Default {
        Build Array(w17) -> w20
        w19 = w17
      }
      frame True {
        call "Modulate Audi.gvi"(set pitch=$"Pitch Frequency", Audio Sample=w17, Slice Set=1024) -> (Waveform=w19, data=w21)
      }
    }
    $Graph <- w19
    call "STFT Spectrogram.gvi"(x=w19, time-frequency sampling information=T1 {"time steps"=-1, "frequency bins"=512}) -> (STFT spectrogram=w22)
    $"Intensity Graph" <- w22
    call "DAQmx Write (Analog 1D DBL 1Chan NSamp).gvi"(error in=w15, task in=w16, data=w19) -> (error out=w23, task out=w24)
    $"error out_2" <- w23
    stop if $stop
  }
  Release Queue(queue=w18)
  call "DAQmx Stop Task.gvi"(task in=w24)
  disable {
    frame Enabled { }
    frame Disabled {
      call "init Tag Read.gvi"() -> (niTag.niTag=w25)
      call "Init tag write.gvi"() -> (niTag.niTag=w26)
      while {
        case ($"Shift Tone_2") {
          frame False, Default { }
          frame True {
            case ($"Shift Tone") {
              frame False, Default { }
              frame True {
                call "Read Tags.gvi"(tag reference in=w25) -> (Responses=w27)
                $Responses <- w27
              }
            }
            call "Write Waveform Tag.gvi"(Waveform=$Graph, Write Task=w26)
          }
        }
        stop if $stop
      }
    }
  }
