vi "Remote Control.gvi"   [Next Generation LabVIEW Features 0.1.0]
panel controls:
  "stop": bool
  "Tone": f64
  "Remote": bool
panel indicators:
  "Intensity Graph": f64[][]
  "Graph": waveform<f64>
  "Responses": i32
uses:
  NI::Analysis::Measurement::STFT Spectrogram.gvi
diagram:
  Obtain Queue(element data type=waveform<f64> {dt=1, Y=[]}, max queue size=1) -> (queue out=w1)
  Obtain Queue(element data type=waveform<f64> {dt=1, Y=[]}, max queue size=1) -> (queue out=w2)
  call "DAQmx Create Task.gvi"() -> (error out=w3, task out=w4)
  call "DAQmx Create Channel (AI-Voltage-Basic).gvi"(error in=w3, task in=w4, physical channels="cDAQ1Mod3/ai0", maximum value=2, minimum value=-2) -> (error out=w5, task out=w6)
  call "DAQmx Timing (Sample Clock).gvi"(error in=w5, task in=w6, rate=51200, sample mode="Continuous Samples"(10123), samples per channel=1024) -> (error out=w7, task out=w8)
  call "DAQmx Start Task.gvi"(error in=w7, task in=w8) -> (task out=w9)
  while {
    call "DAQmx Read (Analog Wfm 1Chan NSamp).gvi"(task in=w9, number of samples per channel=1024) -> (task out=w10, data=w11)
    call "Modulate Audio.gvi"(set pitch=$Tone, Audio Sample=w11) -> (Waveform=w12)
    call "Sound output.gvi"(Waveform Constant=w12) -> (Clipped waveform=w13)
    $Graph <- w13
    Lossy Enqueue Element(element=w12, queue=w1) -> (queue out=w14)
    Lossy Enqueue Element(element=w12, queue=w2) -> (queue out=w15)
    stop if $stop
  }
  call "DAQmx Stop Task.gvi"(task in=w10)
  Release Queue(queue=w14)
  Release Queue(queue=w15)
  while {
    Dequeue Element(queue=w1) -> (element=w16, error out=w17)
    call "STFT Spectrogram.gvi"(x=w16) -> (STFT spectrogram=w18)
    $"Intensity Graph" <- w18
    Wait(time to wait=20)
    stop if w17
  }
  call "Init tag write.gvi"() -> (niTag.niTag=w19)
  call "init Tag Read.gvi"() -> (niTag.niTag=w20)
  while {
    Dequeue Element(queue=w2) -> (element=w21, error out=w22)
    call "Write Waveform Tag.gvi"(Waveform=w21, Write Task=w19)
    Wait(time to wait=100)
    case ($Remote) {
      frame False, Default { }
      frame True {
        call "Read Tags.gvi"(tag reference in=w20) -> (Pitch Ratio=w23, Responses=w24)
        $Responses <- w24
        $Tone <- w23
      }
    }
    stop if w22
  }
