vi "Starting Point.gvi"   [Next Generation LabVIEW Features 0.1.0]
panel indicators:
  "Intensity Graph": f64[][]
diagram:
  call "DAQmx Create Task.gvi"() -> (task out=w1)
  call "DAQmx Create Channel (AI-Voltage-Basic).gvi"(task in=w1, physical channels="myDAQ1/audioInputRight", maximum value=2, minimum value=-2) -> (task out=w2)
  call "DAQmx Timing (Sample Clock).gvi"(task in=w2, rate=22050, sample mode="Continuous Samples"(10123), samples per channel=2048) -> (task out=w3)
  call "DAQmx Start Task.gvi"(task in=w3) -> (task out=w4)
  call "DAQmx Read (Analog Wfm 1Chan NSamp).gvi"(task in=w4, number of samples per channel=2048) -> (task out=w5)
  call "DAQmx Stop Task.gvi"(task in=w5)
