vi "Slice waveform.gvi"   [Next Generation LabVIEW Features 0.1.0]
inputs:
  "Waveform": waveform<f64> = {dt=1, Y=[]}
  "Slice Set": i32 = 1024
  "Error": error
outputs:
  "Waveform_2": waveform<f64>
  "Error_2": error
diagram:
  s1 = uninitialised  # shift register
  while {
    Is First Call() -> w1
    Select(s=w1, t=0, f=s1) -> w2
    Add(w2, $"Slice Set") -> w3
    Property Node(instance in=$Waveform) -> ("Y"=w4, "dt"=w5)
    Array Subset(array=w4, index0=w2, length0=$"Slice Set") -> w6
    Build Waveform Node(Y=w6, dt=w5) -> (output waveform=w7)
    next s1 = w3
    stop if TRUE
  }
  $Waveform_2 <- w7
  $Error_2 <- $Error
