vi "Init tag write.gvi"   [Next Generation LabVIEW Features 0.1.0]
outputs:
  "niTag.niTag": "niTag"
diagram:
  call "Open Tag.gvi"(tag path="waveform") -> (tag reference out=w1, error out=w2)
  call "Create Tag (String).gvi"(tag reference in=w1, error in=w2) -> (tag reference out=w3)
  $"niTag.niTag" <- w3
