vi "Read Tags.gvi"   [Next Generation LabVIEW Features 0.1.0]
outputs:
  "High": f64
  "Low": f64
  "Pitch Ratio": f64
  "Responses": i32
diagram:
  s1 = uninitialised  # shift register
  while {
    Is First Call() -> w1
    case (w1) {
      frame False, Default {
        w2 = s1
      }
      frame True {
        call "init Tag Read.gvi"() -> (niTag.niTag=w2)
      }
    }
    call "Read Double Values.gvi"(tag reference in=w2) -> (tag reference out=w3, aggregate values=w4)
    Property Node(instance in=w4) -> ("mean"=w5, "count"=w6, "max"=w7, "min"=w8)
    Multiply(5, w5) -> w9
    $"Pitch Ratio" <- w9
    $Responses <- w6
    $High <- w7
    $Low <- w8
    next s1 = w3
    stop if TRUE
  }
