vi "Write Waveform Tag.gvi"   [Next Generation LabVIEW Features 0.1.0]
inputs:
  "Waveform": waveform<f64> = {dt=0.1, Y=[]}
panel indicators:
  "Weaveform": f64[]  # Returns the output signal formatted as dynamic data.
uses:
  NI::Analysis::Resampling::Decimate (single shot, DBL).gvi
diagram:
  s1 = uninitialised  # shift register
  while {
    Property Node(instance in=$Waveform) -> ("Y"=w1)
    call "Decimate (single shot, DBL).gvi"(input array=w1, decimating factor=10) -> (decimated array=w2)
    $Weaveform <- w2
    Is First Call() -> w3
    case (w3) {
      frame False, Default {
        w4 = s1
      }
      frame True {
        call "Init tag write.gvi"() -> (niTag.niTag=w4)
      }
    }
    Flatten To JSON(anything=w2) -> (JSON string=w5, error out=w6)
    call "Write (String).gvi"(tag reference in=w4, error in=w6, string=w5)
    next s1 = w4
    stop if TRUE
  }
