vi "Function_4.gvi"   [Next Generation LabVIEW Features 0.1.0]
panel controls:
  "Boolean": bool
panel indicators:
  "data": waveform<f64>[]
types:
  "Sound Data Format.gtype" = cluster{"sample rate (S/s)": f64, "number of channels": i32, "bits per sample": i32}
diagram:
  w1 = "Sound Data Format.gtype" {"sample rate (S/s)"=22050, "number of channels"=2, "bits per sample"=16}
  call "Sound Input Configure.gvi"(sound format=w1, sample mode="Continuous Samples"(1), number of samples/ch=100000) -> (task ID=w2)
  while {
    call "Sound Input Read.gvi"(task ID in=w2, number of samples/ch=100000) -> (task ID out=w3, data=w4)
    $data <- w4
    stop if $Boolean
  }
  call "Sound Input Stop.gvi"(task ID in=w3) -> (task ID out=w5)
  call "Sound Input Clear.gvi"(task ID=w5)
