vi "Keynote Dashboard.gvi"   [Next Generation LabVIEW Features 0.1.0]
panel controls:
  "stop": bool
  "Shift Tone": bool
  "Slider": f64
  "True Constant": bool = TRUE
panel indicators:
  "Graph": waveform<f64>
  "Responses": i32
  "Intensity Graph": f64[][]
types:
  "Sound Data Format.gtype" = cluster{"sample rate (S/s)": f64, "number of channels": i32, "bits per sample": i32}
uses:
  NI::Analysis::Measurement::STFT Spectrogram.gvi
  NI::Analysis::Filtering::Butterworth Bandpass Filter (Waveform).gvi
diagram:
  w1 = "Sound Data Format.gtype" {"sample rate (S/s)"=44100, "number of channels"=2, "bits per sample"=16}
  call "Sound Output Configure.gvi"(sound format=w1, number of samples/ch=1024) -> (task ID=w2)
  call "Sound Output Start.gvi"(task ID in=w2) -> (task ID out=w3)
  s1 = w3  # shift register
  while {
    call "Read Audio Port.gvi"(Number of Samples=1024) -> (data=w4)
    case ($"Shift Tone") {
      frame False, Default {
        Build Array(w4) -> w6
        w5 = w4
      }
      frame True {
        call "Pitch Change.gvi"(Waveform in=w4, Frame size=1024, Overlap=16, Reset=$"True Constant", PitchRatio=$Slider) -> (Array of Waveform=w6, Waveform out=w5)
      }
    }
    $Graph <- w5
    call "STFT Spectrogram.gvi"(x=w5) -> (STFT spectrogram=w7)
    $"Intensity Graph" <- w7
    call "Sound Output Write.gvi"(task ID in=s1, data=w6) -> (task ID out=w8)
    disable {
      frame Enabled { }
      frame Disabled {
        call "Butterworth Bandpass Filter (Waveform).gvi"(high cutoff frequency=783.222, low cutoff frequency=321.322, reset=FALSE, order=1)
      }
    }
    next s1 = w8
    stop if $stop
  }
  call "init Tag Read.gvi"() -> (niTag.niTag=w9)
  call "Init tag write.gvi"() -> (niTag.niTag=w10)
  while {
    case ($"Shift Tone") {
      frame False, Default { }
      frame True {
        call "Read Tags.gvi"(tag reference in=w9) -> (Responses=w11)
        $Responses <- w11
      }
    }
    call "Write Waveform Tag.gvi"(Waveform=$Graph, Write Task=w10)
    Wait(time to wait=100)
    stop if $stop
  }
