vi "Modulate Audio.gvi"   [Next Generation LabVIEW Features 0.1.0]
inputs:
  "set pitch": f64 = 5
  "Audio Sample": waveform<f64> = {dt=0.1, Y=[]}, required
  "Error": error
  "Slice Set": i32 = 2048
outputs:
  "Waveform": waveform<f64>
  "data": waveform<f64>[]
  "error in": error
  "Last Sample?": bool
diagram:
  Property Node(instance in=$"Audio Sample") -> ("attributes"=w1)
  Variant To Data(type=string "Live", variant=w1) -> (data=w2)
  Is Equal(x=w2, y=string "Live") -> w3
  case (w3) {
    frame True {
      call "Pitch Change.gvi"(Waveform in=$"Audio Sample", Frame size=$"Slice Set", PitchRatio=$"set pitch") -> (Array of Waveform=w5, Waveform out=w4)
      w6 = $Error
      w7 = FALSE
    }
    frame False {
      call "Slice waveform.gvi"(Waveform=$"Audio Sample", Slice Set=$"Slice Set", Error=$Error) -> (Waveform_2=w8, Error_2=w9, Last Sample=w7)
      call "Vocoder OLD.gvi"(set pitch=$"set pitch", Waveform_2=w8, Error=w9, Window=$"Slice Set") -> (Waveform out=w4, data=w5, error in=w6)
    }
  }
  $Waveform <- w4
  $data <- w5
  $"Last Sample?" <- w7
  $"error in" <- w6
