vi "Read Audio Port.gvi"   [Next Generation LabVIEW Features 0.1.0]
panel indicators:
  "data": waveform<f64>[]
  "Error": error
  "size(s)": i32
diagram:
  call "DAQmx Create Task.gvi"() -> (task out=w1)
  call "DAQmx Create Channel (AI-Voltage-Basic).gvi"(task in=w1, physical channels="myDAQ1/audioInputLeft", maximum value=1, minimum value=-1) -> (task out=w2)
  call "DAQmx Timing (Sample Clock).gvi"(task in=w2, rate=44000, samples per channel=1024) -> (task out=w3)
  while {
    call "DAQmx Read (Analog 1D Wfm NChan NSamp Duration).gvi"(task in=w3, duration=1) -> (error out=w4, data=w5)
    $data <- w5
    Array Index(array=w5) -> (out0[_]=w6)
    Property Node(instance in=w6) -> ("Y"=w7)
    Array Size(array=w7) -> (size(s)=w8)
    $"size(s)" <- w8
    stop if w4
  }
  $Error <- w4
