vi "Sound output.gvi"   [Next Generation LabVIEW Features 0.1.0]
inputs:
  "Waveform Constant": waveform<f64> = {dt=0.1, Y=[]}
  "Volume": f64 = 4
outputs:
  "data_2": waveform<f64>
diagram:
  s1 = uninitialised  # shift register
  while {
    Is First Call() -> w2
    case (w2) {
      frame False, Default {
        w3 = s1
      }
      frame True {
        call "DAQmx Create Task.gvi"() -> (error out=w4, task out=w5)
        call "DAQmx Create Channel (AO-Voltage-Basic).gvi"(error in=w4, task in=w5, physical channels="cDAQ4Mod4/ao0", maximum value=4, minimum value=-4) -> (error out=w6, task out=w7)
        call "DAQmx Timing (Sample Clock).gvi"(error in=w6, task in=w7, rate=51200, sample mode="Continuous Samples"(10123), samples per channel=100000) -> (error out=w8, task out=w9)
        Property Node(instance in=w9, "RegenMode_1453"="Do Not Allow Regeneration"(10158), error in=w8) -> (error out=w10, instance out=w11)
        Initialize Array(element=0, size=1024) -> w12
        call "DAQmx Write (Analog 1D DBL 1Chan NSamp).gvi"(error in=w10, task in=w11, data=w12) -> (error out=w13, task out=w14)
        call "DAQmx Start Task.gvi"(error in=w13, task in=w14) -> (task out=w3)
      }
    }
    call "DAQmx Write (Analog 1D DBL 1Chan NSamp).gvi"(task in=w3, data=w15) -> (error out=w16, task out=w17)
    w1 = w15
    next s1 = w17
    stop if TRUE
  }
  $data_2 <- w1
  Waveform Multiply($"Waveform Constant", $Volume)
