vi "Vocoder OLD.gvi"   [Next Generation LabVIEW Features 0.1.0]
inputs:
  "Modulation Scheme": bool
  "Enable Pitch Shift Button": bool
  "Waveform_2": waveform<f64> = {dt=1, Y=[]}
  "Error": error
outputs:
  "x": f64[]
  "data": waveform<f64>[]
  "error in": error
diagram:
  Select(s=$"Modulation Scheme", t=1.5, f=0.8) -> w1
  Select(s=$"Enable Pitch Shift Button", t=w1, f=1) -> w2
  call "Pitch Change.gvi"(Waveform in=$Waveform_2, Frame size=2048, Overlap=32, PitchRatio=w2) -> (Waveform out=w3)
  Build Array(w3) -> w4
  $data <- w4
  $x <- w3
  $"error in" <- $Error
