vi "Function.gvi"   [LabVIEW Platform Developer Preview 0.1.0]
panel controls:
  "Low": bool
  "High": bool
panel indicators:
  "Graph": f64[]
  "Current Modulation": f64
  "Number of Updates": f64
  "Average": f64
  "Last Updated": string
uses:
  Component::Read Tag Waveform.gvi
  Component::Read Double Tag.gvi
  Component::Update Tag.gvi
diagram:
  while {
    Wait(time to wait=1000)
    call "Read Tag Waveform.gvi"(Server="skyline.southcentralus.cloudapp.azure.com", Tag="waveform") -> (values=w1, Timestamp=w2)
    $Graph <- w1
    $"Last Updated" <- w2
    call "Read Double Tag.gvi"(Server="skyline.southcentralus.cloudapp.azure.com", Tag="modulation") -> (Value=w3, Count=w4, Average=w5)
    $"Current Modulation" <- w3
    $"Number of Updates" <- w4
    $Average <- w5
    stop if FALSE
  }
  while {
    Wait(time to wait=100)
    case ($Low) {
      frame False, Default { }
      frame True {
        call "Update Tag.gvi"(Server="skyline.southcentralus.cloudapp.azure.com", Tag="modulation", Tag Value=0)
      }
    }
    case ($High) {
      frame False, Default { }
      frame True {
        call "Update Tag.gvi"(Server="skyline.southcentralus.cloudapp.azure.com", Tag="modulation", Tag Value=1)
      }
    }
    stop if FALSE
  }
